# Grasshopper definition 303_class_brickwall.gh (Grasshopper 1.0.7)
# plug-ins: Human

angle = Slider(0, range=-90..90)
crv = Curve(<curve referenced from the Rhino model>)
crv_2 = Curve(<curve referenced from the Rhino model>)

pt = Point([Point(96.70682423, -181.7718549, 60.94489684), Point(325.8521491, -26.18281587, 0), Point(-73.10350935, -9.961704665, 49.57028638)])
python = GhPythonScript(
    curve=crv_2,
    attractor=pt,
    wallHeight=Slider(65, range=1..200),
    brickHeight=Slider(6, range=0..10),
    brickWidth=Slider(11, range=0..100),
    brickLength=Slider(20, range=0..100),
    tolerance=Slider(7.6, range=0..10),
    type=Slider(2, range=0..2),
    angle=Slider(70, range=0..360),
    farthest=Slider(200, range=0..200))  # -> out, brick, color, oPt; inputs curve: Curve, attractor: list of Point3d, type: Int32
# ---------- python: Python ----------
import Rhino.Geometry as rg
from ghpythonlib.components import ColourRGB, Pipe
import math

class Wall:
    def __init__(self, crv, Height, attr):
        #Generate wall
        self.crv = crv
        self.Height = Height
        self.attr = attr
        surf = rg.Surface.CreateExtrusion(self.crv, rg.Vector3d(0, 0, Height)).ToBrep()
        
        #Generate crv according to the altitude
        layerNum = int(Height/brickHeight)
        self.contourCrv = []
        for i in range(layerNum):
            cut = rg.Brep.CreateContourCurves(surf, rg.Plane(rg.Point3d(0,0,i*brickHeight), rg.Vector3d(0,0,1)))
            self.contourCrv.extend(cut)
        
        #The position of brick
        self.crvPts = []
        self.crvID = []
        for i, crv in enumerate(self.contourCrv):
            #even layers, crvs in this layer were shortened
            if i%2 == 0:
                crvTrim = crv.Trim(rg.CurveEnd.Start, brickLength/2 + tolerance/2)
                self.contourCrv[i]=crvTrim
            #odd layers
            else:
                pass
        
        #divide the crv according to the length of bricks
        for i,crv in enumerate(self.contourCrv):
            ptsParam = rg.Curve.DivideByLength(crv, brickLength + tolerance, 1)
            for param in ptsParam:
                pts = crv.PointAt(param)
                self.crvPts.append(pts)
                self.crvID.append(i)
        
        #Find out the direction of brick
        self.vecList = []
        for i in range(len(self.crvPts)):
            para = self.contourCrv[self.crvID[i]].ClosestPoint(self.crvPts[i])[1]
            vec = self.contourCrv[self.crvID[i]].TangentAt(para)
            #vec.Unitize()
            self.vecList.append(vec)
        #help(rg.Curve.ClosestPoint)
        
        #Different types
        if type == 1:
            for i in range(len(self.vecList)):
                if self.crvID[i]%2 ==0:
                    self.vecList[i].Rotate(angle*math.pi*2/360, rg.Vector3d(0,0,1))
        
        if type == 2:
            self.rotateAngle = []
            for i in self.crvPts:
                minDist = self.attrDist(i)
                if minDist < farthest:
                    rot=1
                    rot *= (farthest - minDist)/(farthest)*angle
                    self.rotateAngle.append(rot)
                else:
                    self.rotateAngle.append(0)
            for i in range(len(self.vecList)):
                #if self.crvID[i]%2 ==0:
                if True:
                    self.vecList[i].Rotate(self.rotateAngle[i]*math.pi*2/360, rg.Vector3d(0,0,1))


    def attrDist(self, pt):
        minDist = -1
        for attPt in self.attr:
            dist = pt.DistanceTo(attPt)
            if minDist<0 or dist<minDist:
                minDist = dist
        return minDist


    def color(self):
        self.color = []
        for i in self.crvPts:
            minDist = self.attrDist(i)
            if minDist < farthest:
                c=1
                c *= (farthest - minDist)/(farthest)*255
                self.color.append(ColourRGB(255,c,c,c))
            else:
                self.color.append(ColourRGB(255,0,0,0))



    #Use class Rect to stack bricks on the wall
    def stack(self):
        self.brick = []
        self.brickColor = []
        for m in range(len(self.crvPts)):
            r = Rect(self.crvPts[m][0], self.crvPts[m][1], self.crvPts[m][2], brickWidth, brickHeight, brickLength, v=self.vecList[m], c=(255,255,255,255))
            r.draw()
            self.brick.append(r.rect)
            self.brickColor.append(r.color)



class Rect:
    """
    infos
    """
    # initialize my object
    def __init__(self, x, y, z, w, d, h, v=(0,0,1), c=(255,255,255,255)):
        self.x = x
        self.y = y
        self.z = z
        self.vector = rg.Vector3d(v[0], v[1], v[2])
        self.center = rg.Point3d(x,y,z)
        self.plane = rg.Plane(self.center, self.vector)
        self.w = w
        self.d = d
        self.h = h
        self.volume = w * d * h
        
        self.rect = None
        self.color = ColourRGB(c[0], c[1], c[2], c[3])


    def draw(self):
        self.rect = rg.Box(self.plane,
                           rg.Interval(-self.w/2,self.w/2),
                           rg.Interval(-self.d/2,self.d/2),
                           rg.Interval(-self.h/2, self.h/2))



a = Wall(curve, wallHeight, attractor)
b = a.contourCrv
oPt = a.crvPts

a.color()
a.stack()
brick = a.brick
color = a.color
# ---------- end python ----------

python_2 = GhPythonScript(crv=crv, layer_num=Slider(8, range=0..100), bricks_num=Slider(40, range=0..100), bricks_angle=angle)  # -> out, a, pt_bricks, crvs, bricks; inputs crv: Curve, layer_num: Int32, bricks_num: Int32, bricks_angle: Int32
# ---------- python_2: Python ----------
import rhinoscriptsyntax as rs
import Rhino.Geometry as rg
import math
import copy
import System
import ghpythonlib.treehelpers as th

length = 30
width = 15
height = 10



class Brickwall(object):
    
    """
    this is a class to create a wall from a input curve and get the origin for its bricks
    
    """
    
    # this varible was defined outside of the class
    # we need to declare it as global so it will be shared by all instances of the class
    global height
    
    
    # this method gets calles as soon as the object of a class is initiated
    # here we define instance variables = attributes of the object
    def __init__(self,curve,layer_cnt, brick_cnt):
        
        self.curve = curve
        self.layer_cnt = layer_cnt
        self.brick_cnt = brick_cnt
        
        self.crvs = self.get_layers()
        self.bpts,self.bpts_tan = self.get_bricks()
        
    # this method will be called in the __init__ function
    # it returns a list of curves 
    def get_layers(self):
        
        crvs = []
        for i in range(self.layer_cnt):
            T = rg.Transform.Translation(rg.Vector3d(0,0,i*height))
            c = copy.copy(self.curve)
            c.Transform(T)
            crvs.append(c)
        return crvs
    
    # this method will be called in the __init__ function as well
    # it divides the curves into points and returns the list of points and its tangents
    def get_bricks(self):
        
        bricks = []
        bricks_tan = []
        
        for i, c in enumerate(self.crvs):
            params = c.DivideByCount(self.brick_cnt*2,True)
            pts = []
            tngts = []
            # list comprehension
            pts = [ c.PointAt(p) for p in params[i%2::2]]
            tngts = [ c.TangentAt(p) for p in params[i%2::2]]
                
            bricks.append(pts)
            bricks_tan.append(tngts)
            
        return bricks,bricks_tan


class Brick(object):
    
    """
    this is a class to make a brick
    """
    
    global length
    global width
    global height

    # this method gets calles as soon as the object of a class is initiated
    # here we define instance variables = attributes of the object
    def __init__(self, origin, vec):
        
        
        self.origin = origin 
        self.vec = vec # point's tangent vector

        
        self.pts = self.brick_pts()
        
        self.start_plane = self.get_start_plane()
        self.target_plane = self.get_target_plane()
        
        self.mesh = self.brick_mesh()
        
        
    # this method will be called in the __init__ function
    # it returns a list of 8 points of the bounding box 
    def brick_pts(self):
        
        pt_0 = rg.Point3d(self.origin.X-length/2, self.origin.Y-width/2, self.origin.Z)
        pt_1 = rg.Point3d(pt_0.X + length, pt_0.Y, self.origin.Z)
        pt_2 = rg.Point3d(pt_1.X, pt_1.Y + width, self.origin.Z)
        pt_3 = rg.Point3d(pt_2.X - length, pt_2.Y, self.origin.Z)

        pt_4 = rg.Point3d(pt_0.X, pt_0.Y, pt_0.Z + height)
        pt_5 = rg.Point3d(pt_1.X, pt_1.Y, pt_1.Z + height)
        pt_6 = rg.Point3d(pt_2.X, pt_2.Y, pt_2.Z + height)
        pt_7 = rg.Point3d(pt_3.X, pt_3.Y, pt_3.Z + height)

        b_pts = [pt_0, pt_1, pt_2, pt_3, pt_4, pt_5, pt_6, pt_7]

        return b_pts
    
    # this method is called in the __init__ function
    # it returns the start_plane of the brick accodring to boolean input
    def get_start_plane(self):
        
        yvec = rg.Vector3d.CrossProduct(rg.Vector3d(0,0,1), self.vec)
        start_plane = rg.Plane(self.origin, self.vec, yvec)
            
        return start_plane
    
    # this method is called in the __init__ function
    # it returns the rotated start plabe plane according to input value 
    def get_target_plane(self):
        c = copy.copy(self.start_plane)
        c.Rotate(math.radians(bricks_angle), rg.Vector3d.ZAxis, self.origin)
        return c
    
    # this method is called in the __init__ funciton
    # it creates the mesh from 8 points, transforms its plane and returns the mesh 
    def brick_mesh(self):
        br = rg.Mesh.CreateFromBox(self.pts,1,1,1)
        P = rg.Plane(self.origin, rg.Vector3d.XAxis, rg.Vector3d.YAxis)
        T1 = rg.Transform.PlaneToPlane(P, self.start_plane)
        T2 = rg.Transform.PlaneToPlane(self.start_plane, self.target_plane)
        br.Transform(T1)
        br.Transform(T2)
        
        return br

# calling the object
wall = Brickwall(crv,layer_num,bricks_num)
# assigning its attribute to a variable crvs
crvs = wall.crvs
# to visualize the bricks in gh we transform it to a tree
pt_bricks = th.list_to_tree(wall.bpts)


bricks = []


for _pt,_t in zip(wall.bpts, wall.bpts_tan):
    for pt,t, in zip(_pt,_t):
        b = Brick(pt,t)
        bricks.append(b.mesh)
# ---------- end python_2 ----------
# #            for p in params[i%2::2]:
# #                pt = c.PointAt(p)
# #                t = c.TangentAt(p)
# #
# #                pts.append(pt)
# #                tngts.append(t)
pt_2 = Point(flatten(python_2.pt_bricks))
crv_3 = Curve(python_2.crvs)
mesh = Mesh(python_2.bricks)
preview = CustomPreview(Geometry=mesh, Material=ColourSwatch(SwatchColor=RGB(99, 107, 255)))
python_3 = GhPythonScript(bricks=python.brick, num=Slider(100, range=0..100), start=Slider(0, range=0..700))  # -> out, a; inputs bricks: list of Brep, num: Int32, start: Int32
# ---------- python_3: Python ----------
import Rhino.Geometry as rg

if start+num<len(bricks):
    pick = bricks[start:start+num]
else:
    pick = bricks[len(bricks)-num:len(bricks)+1]

a = pick
# ---------- end python_3 ----------
edges = BrepEdges(Brep=python.brick)  # -> Naked, Interior, NonManifold
lng = ListLength(List=python_3.a)
panel = Panel(lng)
preview_2 = CustomPreview(Geometry=python.brick, Material=ColourSwatch(SwatchColor=RGB(222, 222, 222)))
previewlw = CustomPreviewLineweights(Geometry=[edges.Naked, edges.Interior], Shader=ColourSwatch(SwatchColor=RGB(0, 0, 0)), Absolute=False)
